# Dynamo graph DXF_to_COGO_v2.0.dyn (Dynamo 3.0.3.7597)
# author: Michael Gonzalez
# packages: Civil3DToolkit 1.1.32

# note: Version 1.0
# By MG

current = Autodesk.AutoCAD.DynamoNodes.Document.Current()

# group: Type "Block Name"
block_name = StringInput("DIAG_CROSS")  # graph input

blockByName = Autodesk.AutoCAD.DynamoNodes.Document.BlockByName(document=current, name=block_name)
blockReferences = Autodesk.AutoCAD.DynamoNodes.Block.BlockReferences(block=blockByName)

# group: Type block layer
block_layer = StringInput("Points")

byBlockReference = Autodesk.Civil.DynamoNodes.CogoPoint.ByBlockReference(blockReference=blockReferences, layer=block_layer, document=current)

# group: Select attibute to be assigned To COGO Description
select_attribute_to_be_assigned = StringInput("Code")  # "Select attribute to be assigned to COGO Description"; graph input

attributeByTag = Autodesk.AutoCAD.DynamoNodes.BlockReference.AttributeByTag(blockReference=blockReferences, tag=select_attribute_to_be_assigned)
setDescription = Autodesk.Civil.DynamoNodes.LandDevelopment.CogoPointExtensions.SetDescription(cogoPoint=byBlockReference, description=attributeByTag)

# group: Type COGO group name
point_group_name = StringInput("DXF_to_COGO")  # graph input

# group: Cretaing Point Group
byCogoPoints = Autodesk.Civil.DynamoNodes.CogoPointGroup.ByCogoPoints(cogoPoints=setDescription, cogoPointGroupName=point_group_name, document=current)

# group: Checking Block Attributes
hasAttributes = Autodesk.AutoCAD.DynamoNodes.BlockReference.HasAttributes(blockReference=blockReferences)
attributeTags = Autodesk.AutoCAD.DynamoNodes.BlockReference.AttributeTags(blockReference=blockReferences)
